# Grasshopper definition SampleGHDocInput.gh (Grasshopper 1.0.7)

# ---- group: Some sample data
txt = Text(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)

# ----
encodedfile = GetString(txt, AtLeast=1, AtMost=1, TreeAccess=False)
c_script = CSharpScript(data=encodedfile)  # -> out, A; inputs data: String
# ---------- c_script: C# usings ----------
using System.IO;
# ---------- c_script: C# ----------
var tmp = Path.GetTempFileName();
tmp = Path.ChangeExtension(tmp, "3dm");

var b64 = System.Convert.FromBase64String( data );

File.WriteAllBytes(tmp, b64);

A = tmp;
# ---------- end c_script ----------
_3dm = Import3DM(File=c_script.A, Layer="*", Name="*")

# ---- group: assumes SubD
meshsubd = MeshFromSubD(SubD=_3dm, Density=2)

# ----
demesh = DeconstructMesh(Mesh=meshsubd)  # -> Vertices, Faces, Colours, Normals
mcol = MeshColours(Mesh=meshsubd, Colours=demesh.Normals)
context_bake = ContextBake(Geometry=mcol)
