# Grasshopper definition SampleGHConvertTo3dm.gh (Grasshopper 1.0.7)

# ---- group: sample data
panel = Panel(".fbx")
txt = Text(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)

txt_2 = Text(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)
panel_2 = Panel(".obj")

# ----
encodedfile = GetString(txt, AtLeast=1, AtMost=1, TreeAccess=False)
extension = GetString(panel, AtLeast=1, AtMost=1, TreeAccess=False)
c_script = CSharpScript(data=encodedfile, ext=extension)  # -> out, A; inputs data: String, ext: String
# ---------- c_script: C# usings ----------
using System.IO;
# ---------- c_script: C# ----------
    if( null == data || null == ext ) return;

    var decodedData = Convert.FromBase64String(data);

    var tmpPath = Path.GetTempFileName();
    tmpPath = Path.ChangeExtension(tmpPath, ext);

    Print(tmpPath);

    File.WriteAllBytes(tmpPath, decodedData);

    if(File.Exists(tmpPath))
    {
      using( var doc = Rhino.RhinoDoc.CreateHeadless(null)){

        doc.Import(tmpPath);

        var ros = doc.Objects.FindByObjectType(Rhino.DocObjects.ObjectType.Mesh);

        Print("Number of meshes: {0}", ros.Length);

        var meshes = new List<Rhino.Geometry.Mesh>();
        foreach( Rhino.DocObjects.RhinoObject obj in ros )
        {
          meshes.Add(obj.DuplicateGeometry() as Rhino.Geometry.Mesh);
        }

        A = meshes;
      }
    }
# ---------- end c_script ----------
panel_3 = Panel(c_script.out)

# ---- group: RH_OUT:meshes
mesh = Mesh(c_script.A)
