# Grasshopper definition delaunay.gh (Grasshopper 1.0.7)
# Sample shows how to send a list of points and get a mesh.

pop3d = Populate3D(Region={Plane=PlaneXY(0, 0, 0), X=Domain(0, 10), Y=Domain(0, 10), Z=Domain(0, 2)}, Count=100, Seed=1)
points = GetPoint(pop3d, AtLeast=1, AtMost=2147483647, Realtime=True, TreeAccess=False)
del = DelaunayMesh(Points=points, Plane=PlaneXY(0, 0, 0))
context_bake = ContextBake(Geometry=del)
