# Grasshopper definition SampleGHDocMaterialTexture.gh (Grasshopper 1.0.7)

# Sample Data
number_slider = Slider(11.03, range=1..20)
txt = Text("data:image/png;base64,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")
datauri = GetString(txt, AtLeast=1, AtMost=1, TreeAccess=False)
# Inputs
radius = GetNumber(number_slider, AtLeast=1, AtMost=2147483647, Maximum=1.797693135e+308, Minimum=-1.797693135e+308, TreeAccess=False)

# ---- group: Convert dataURI to image and save to disk
c_script = CSharpScript(dataUrl=datauri)  # -> out, A; inputs dataUrl: String
# ---------- c_script: C# usings ----------
using System.IO;
using System.Text.RegularExpressions;
# ---------- c_script: C# ----------
    //https://stackoverflow.com/a/64871744/2179399
    var matchGroups = Regex.Match(dataUrl, @"^data:((?<type>[\w\/]+))?;base64,(?<data>.+)$").Groups;

    var ext = matchGroups["type"].Value;
    ext = "." + ext.Substring(6);
    string filePath = Path.GetTempFileName();
    filePath = Path.ChangeExtension(filePath, ext);

    var base64Data = matchGroups["data"].Value;
    var binData = Convert.FromBase64String(base64Data);

    File.WriteAllBytes(filePath, binData);
    A = filePath;
# ---------- end c_script ----------

# ----
msphere = MeshSphere(Base=PlaneXY(0, 0, 0), Radius=radius, UCount=10, VCount=20)
panel = Panel(c_script.A)
c_script_2 = CSharpScript(obj=msphere, imgPath=c_script.A)  # -> out, A; inputs imgPath: String
# ---------- c_script_2: C# usings ----------
using System.IO;
# ---------- c_script_2: C# ----------
    //following this example for materials and textures
    //https://developer.rhino3d.com/samples/rhinocommon/add-texture/

    var doc = Rhino.RhinoDoc.CreateHeadless(null);

    //material
    var material = new Rhino.DocObjects.Material();
    material.Name = "myMat";
    var render_material = Rhino.Render.RenderMaterial.CreateBasicMaterial(material, doc);

    var texture = new Rhino.DocObjects.Texture();
    texture.FileName = imgPath;

    var sim = new Rhino.Render.SimulatedTexture(doc, texture);
    var render_texture = Rhino.Render.RenderTexture.NewBitmapTexture(sim, doc);
    // Set the texture as a child of the material in the bump slot.
    var child_slot_name = "bitmap-texture";
    render_material.SetChild(render_texture, child_slot_name);
    render_material.SetChildSlotOn(child_slot_name, true, Rhino.Render.RenderContent.ChangeContexts.Program);
    render_material.SetChildSlotAmount(child_slot_name, 100.0, Rhino.Render.RenderContent.ChangeContexts.Program);

    doc.RenderMaterials.Add(render_material);

    var atts = new Rhino.DocObjects.ObjectAttributes();
    atts.Name = "myMesh";
    atts.RenderMaterial = render_material;

    var gb = obj as Rhino.Geometry.GeometryBase;
    var id = doc.Objects.Add(gb, atts);

    //doc to str
    var fwo = new Rhino.FileIO.FileWriteOptions();
    fwo.FileVersion = 7;
    fwo.IncludeBitmapTable = true;

    var tempPath = Path.Combine(Path.GetTempPath(), Path.GetTempFileName());
    tempPath = Path.ChangeExtension(tempPath, ".3dm");
    
    Print(tempPath);

    doc.WriteFile(tempPath, fwo);

    doc.Dispose();

    //doc to str
    var f3wo = new Rhino.FileIO.File3dmWriteOptions();
    f3wo.Version = 7;

    var f3dm = Rhino.FileIO.File3dm.Read(tempPath);
    var arr = f3dm.ToByteArray(f3wo);
    A = Convert.ToBase64String(arr);
# ---------- end c_script_2 ----------
panel_2 = Panel(c_script_2.out)
# Outputs
context_print = ContextPrint(DocString=c_script_2.A)
