# Grasshopper definition SampleMaterialOutput.gh (Grasshopper 1.0.7)
# Testing material output with custom preview

radius = GetNumber(Slider(6, range=1..10), AtLeast=1, AtMost=2147483647, Maximum=1.797693135e+308, Minimum=-1.797693135e+308)
msphere = MeshSphere(Base=PlaneXY(0, 0, 0), Radius=radius, UCount=10, VCount=20)
material = CreateMaterial(
    Diffuse=ColourSwatch(SwatchColor=RGB(237, 95, 25)),
    Specular=RGB(255, 255, 255),
    Emission=RGB(0, 0, 0),
    Transparency="0.5",
    Shine="1")
preview = CustomPreview(Geometry=msphere, Material=material)

# ---- group: RH_OUT:material
shader = Shader(material)

# ---- group: RH_OUT:mesh
mesh = Mesh(msphere)
