# Grasshopper definition SampleGHText.gh (Grasshopper 1.0.7)

spacing = Slider(0.4, range=0.1..5)
inputtext = GetString("ABC", AtLeast=1, AtMost=2147483647, TreeAccess=False)
extrusionheight = GetNumber(
    Slider(0.2, range=0..5),
    AtLeast=1,
    AtMost=2147483647,
    Maximum=1.797693135e+308,
    Minimum=-1.797693135e+308,
    TreeAccess=False)
c_script = CSharpScript(text=inputtext, smallCapScaling=Slider(0.3, range=0.1..5), spacing=spacing, height=extrusionheight, cap=Toggle(True))  # -> out, A; inputs text: String, smallCapScaling: Double, spacing: Double, height: Double, cap: Boolean
# ---------- c_script: C# ----------
    var doc = RhinoDoc.CreateHeadless(null);

    var id = doc.DimStyles.Add("Test");

    var te = new Rhino.Geometry.TextEntity();
    te.Plane = Plane.WorldXY;
    te.PlainText = text;
    te.Justification = TextJustification.Center;
    te.Font = doc.DimStyles[id].Font;

    var ds = new Rhino.DocObjects.DimensionStyle();
    ds.BaselineSpacing = 10;

    if(height == 0)
    {
      if(cap)
        A = te.CreateSurfaces(doc.DimStyles[id], smallCapScaling, spacing);
      else
        A = te.CreateCurves(doc.DimStyles[id], false, smallCapScaling, spacing);

    } else {

      if(cap)
        A = te.CreateExtrusions(doc.DimStyles[id], height, smallCapScaling, spacing);
      else {
        var surfaces = new List<Surface>();
        var vector = Vector3d.ZAxis * height;
        var curves = te.CreateCurves(doc.DimStyles[id], false, smallCapScaling, spacing);
        foreach(var crv in curves)
          surfaces.Add(Extrusion.CreateExtrusion(crv, vector));
        A = surfaces;
      }

    }

    doc.Dispose();
# ---------- end c_script ----------
lng = ListLength(List=c_script.A)
series = Series(Start=0, Step=1, Count=lng)
gradient = Gradient(
    LowerLimit=0,
    UpperLimit=expr("x-1", lng),
    Parameter=series,
    stops=[0: RGB(234, 38, 0), 0.25: RGB(234, 126, 0), 0.5: RGB(254, 244, 84), 0.75: RGB(173, 203, 249), 1: RGB(75, 107, 169)])
mesh = Mesh(simplify(graft(c_script.A)))
wires = BrepWireframe(Brep=c_script.A, Density=-1)  # -> simplify(Wireframe)
material = CreateMaterial(Diffuse=gradient, Specular=RGB(255, 255, 255), Emission=RGB(0, 0, 0), Transparency=0, Shine=0)
graft = GraftTree(Tree=material, IncludeEmptyLists=True, IncludeNullItems=True)  # -> simplify(Tree)
merge = Merge(Data1=wires, Data2=mesh)
preview = CustomPreview(Geometry=mesh, Material=material)
c_script_2 = CSharpScript(objects=merge, materials=graft)  # -> out, str; inputs objects: tree, materials: tree
# ---------- c_script_2: C# ----------
    if(objects.BranchCount != materials.BranchCount) return;

    var doc = new Rhino.FileIO.File3dm();

    //go through branches
    for(int i = 0; i < objects.BranchCount; i++)
    {
      var mat = materials.Branches[i][0] as Rhino.Display.DisplayMaterial;
      var objs = objects.Branches[i];

      var material = new Rhino.DocObjects.Material();
      material.DiffuseColor = mat.Diffuse;
      material.EmissionColor = mat.Emission;
      material.Transparency = mat.Transparency;
      material.Shine = mat.Shine;
      material.SpecularColor = mat.Specular;

      var atts = new Rhino.DocObjects.ObjectAttributes();
      atts.MaterialSource = Rhino.DocObjects.ObjectMaterialSource.MaterialFromObject;

      doc.AllMaterials.Add(material);
      atts.MaterialIndex = i;

      for(int j = 0; j < objs.Count; j++)
      {
        var obj = objs[j] as Rhino.Geometry.GeometryBase;
        Print(obj.ToString());

        switch(obj.ObjectType)
        {
          case Rhino.DocObjects.ObjectType.Curve:
            doc.Objects.AddCurve(obj as Curve, atts);
            break;
          case Rhino.DocObjects.ObjectType.Mesh:
            doc.Objects.AddMesh(obj as Mesh, atts);
            break;
        }
      }

    }

    var fwo = new Rhino.FileIO.File3dmWriteOptions();
    fwo.Version = 7;
    var arr = doc.ToByteArray(fwo);

    str = Convert.ToBase64String(arr);

    doc.Dispose();
# ---------- end c_script_2 ----------
context_print = ContextPrint(DocString=c_script_2.str)
