# Grasshopper definition SampleGHSTLInput.gh (Grasshopper 1.0.7)

mesh = Mesh(<mesh referenced from the Rhino model>)
mainmesh = GetGeometry(mesh, AtLeast=1, AtMost=1, DeleteInput=False, Filter=1074004029, TreeAccess=False)
qrsettings = QuadRemeshSettings(
    TargetCount=1000,
    AdaptiveSize=0,
    AdaptiveCount=Toggle(True),
    HardEdges=Toggle(True),
    SeamEdges=0,
    Symmetry=0,
    GuideCurves=0)
qrmesh = QuadRemesh(Mesh=mainmesh, Settings=qrsettings)
demesh = DeconstructMesh(Mesh=qrmesh)  # -> Vertices, Faces, Colours, Normals
deface = DeconstructFace(Face=demesh.Faces)  # -> CornerA, CornerB, CornerC, CornerD
item = ListItem(List=demesh.Vertices, Index=deface.CornerA, Wrap=True)  # -> graft(Item)
item_2 = ListItem(List=demesh.Vertices, Index=deface.CornerB, Wrap=True)  # -> graft(Item)
item_3 = ListItem(List=demesh.Vertices, Index=deface.CornerC, Wrap=True)  # -> graft(Item)
item_4 = ListItem(List=demesh.Vertices, Index=deface.CornerD, Wrap=True)  # -> graft(Item)
merge = Merge(Data1=item, Data2=item_2, Data3=item_3, Data4=item_4)
facen = FaceNormals(Mesh=qrmesh)  # -> Centers, simplify(graft(Normals))
quad = MeshQuad(CornerA=0, CornerB=1, CornerC=2, CornerD=3)
conmesh = ConstructMesh(Vertices=simplify(merge), Faces=quad, Colours=facen.Normals)  # -> flatten(Mesh)
txt = Text(conmesh)
expression = Expression(x=txt, y="Invalid Mesh", Expression="x ≠ y")
cull = CullPattern(List=conmesh, CullPattern=expression)
mjoin = MeshJoin(Meshes=cull)
context_bake = ContextBake(Geometry=mjoin)
