# Grasshopper definition twisty.gh (Grasshopper 1.0.7)

circle = Circle({Plane=PlaneXY(0, 0, 0), Radius=5})
curve = GetGeometry(circle, AtLeast=1, AtMost=2147483647, Filter=1073741828)
rotate = GetNumber("110", AtLeast=1, AtMost=2147483647, Maximum=1.797693135e+308, Minimum=-1.797693135e+308)
Z = UnitZ(Factor=Slider(15, range=0..100))
move = Move(Geometry=curve, Motion=Z)  # -> Geometry, Transform
rad = Radians(Degrees=rotate)
rotate_2 = Rotate(Geometry=move.Geometry, Angle=rad, Plane=PlaneXY(0, 0, 0))  # -> Geometry, Transform
divide = DivideCurve(Curve=curve, Count=10, Kinks=False)  # -> Points, Tangents, Parameters
divide_2 = DivideCurve(Curve=rotate_2.Geometry, Count=10, Kinks=False)  # -> Points, Tangents, Parameters
ln = Line(StartPoint=divide.Points, EndPoint=divide_2.Points)

# ---- group: RH_OUT:lines
crv = Curve(ln)
