# Grasshopper definition DifferentPrimitives.gh (Grasshopper 1.0.7)

testcircle2 = Circle(Plane=PlaneXY(0, 0, 0), Radius=5)
testln2 = Line(StartPoint=Point(0, 0, 0), EndPoint=Point(-3, 8, -4))
testcircleoutput2 = Circle(testcircle2)
testlineoutput2 = Line(testln2)
