# Grasshopper definition Primitives.gh (Grasshopper 1.0.7)

testcircle = Circle(Plane=PlaneXY(0, 0, 0), Radius=1)
testln = Line(StartPoint=Point(0, 0, 0), EndPoint=Point(1, -5, 3))
testcircleoutput = Circle(testcircle)
testlineoutput = Line(testln)
